# Dynamo graph 01_Basic_Import.dyn (Dynamo 1.3.0.875)

file_path = Filename("svg_samples\lady_resultStrokeAndFill.svg")
importFile = SVGImport.SVG.ImportFile(file_path)
watch = Watch(importFile.out1)
