# Dynamo graph 02_Multiple_SVG_Import.dyn (Dynamo 1.3.0.875)

directory_path = Directory("C:\Users\JLXMac\AppData\Roaming\Dynamo\Dynamo Core\1.3\packages\SVG Import\extra\svg_3dprint_slices")
fromPath = DirectoryObject(directory_path)  # "Directory.FromPath"
code_block = CodeBlock { "*.svg"; }
contents = Directory.Contents(fromPath, code_block)
importFile = SVGImport.SVG.ImportFile(contents)
watch = Watch(importFile.out1)
